% Simulink data dictionary PCS_Simulation_EnviromentDD.sldd

Command = Simulink.Bus()
  DCDCControlMode: double
  InvControlMode: int32

SensorData = Simulink.Bus()
  PVOutVoltage: double
  PVOutCurrent: double
  DCBusVoltage: double
  DCBusInCurrent: double
  DCBusOutCurrent: double
  InvOutVoltage: double
  InvOutCurrent: double

DDPWMDuty = Simulink.Bus()
  DDDuty: double

InverterPWMVoltage = Simulink.Bus()
  L1_High: double
  L1_Low: double
  L2_High: double
  L2_Low: double

DescrizedSensorData = Simulink.Bus()
  PVOutVoltage: double
  PVOutCurrent: double
  DCBusVoltage: double
  DCBusInCurrent: double
  DCBusOutCurrent: double
  InvOutVoltage: double
  InvOutCurrent: double

InverterModuationRate = Simulink.Bus()
  ModulationRate: boolean

DDPWMVoltage = Simulink.Bus()
  DDPWMVoltage: double