% Simulink data dictionary PCS_Simulation_EnviromentDD.sldd

Command = Simulink.Bus()
  DCDCControlMode: double
  InvControlMode: int32

SensorData = Simulink.Bus()
  PVOutVoltage: double
  PVOutCurrent: double
  DCBusVoltage: double
  DCBusInCurrent: double
  DCBusOutCurrent: double
  InvOutVoltage: double
  InvOutCurrent: double

DDPWMDuty = Simulink.Bus()
  DDDuty: double

InverterPWMDuty = Simulink.Bus()
  L1_LowDuty: boolean
  L1_HighDuty: double
  L2_LowDuty: double
  L2_HighDuty: double